# Grasshopper definition LCA - Office Building.gh (Grasshopper 1.0.7)
# plug-ins: Karamba3D, One Click LCA, KarambaPack

number_slider = Slider(450, range=0..1000)
number_slider_2 = Slider(450, range=0..1000)
number_slider_3 = Slider(690, range=0..1000)
number_slider_4 = Slider(109, range=30..150)
matprops = MaterialPropertiesKaramba3D(
    FamilyOfMaterial="Timber",
    Name="CLT - Slab",
    YoungsModulus_kN_cm2=Slider(1170, range=0..10000),
    InPlaneShearModulus_kN_cm2=number_slider,
    TransverseShearModulus_kN_cm2=number_slider,
    SpecificWeight_kN_m3=Slider(5, range=0..10),
    CoefficientOfThermalExpansion_1_C=1e-05,
    YieldStrength_kN_cm2=23.5,
    mode="Isotrop")
matprops_2 = MaterialPropertiesKaramba3D(
    FamilyOfMaterial="Timber",
    Name="CLT - Columns",
    YoungsModulus_kN_cm2=Slider(1170, range=0..10000),
    InPlaneShearModulus_kN_cm2=number_slider_2,
    TransverseShearModulus_kN_cm2=number_slider_2,
    SpecificWeight_kN_m3=Slider(5, range=0..10),
    CoefficientOfThermalExpansion_1_C=1e-05,
    YieldStrength_kN_cm2=23.5,
    mode="Isotrop")
matprops_3 = MaterialPropertiesKaramba3D(
    FamilyOfMaterial="Timber",
    Name="LVL",
    YoungsModulus_kN_cm2=Slider(1800, range=0..10000),
    InPlaneShearModulus_kN_cm2=number_slider_3,
    TransverseShearModulus_kN_cm2=number_slider_3,
    SpecificWeight_kN_m3=Slider(5.5, range=0..10),
    CoefficientOfThermalExpansion_1_C=1e-05,
    YieldStrength_kN_cm2=23.5,
    mode="Isotrop")
matselect = MaterialSelectionKaramba3D(menu=[dropdown(3), dropdown(7)])
number_slider_5 = Slider(40, range=0..100)
number_slider_6 = Slider(30, range=0..100)
Z = UnitZ(Factor=number_slider_4)
number_slider_7 = Slider(26, range=10..40)
neg = Negative(Value=Z)
division = Division(A=neg, B="2")
cross_section = CrossSectionKaramba3D(FamilyNameOfCrossSection="DefaultCroSec", Material=matselect, Height_cm=Slider(30, range=0..100), mode="Shell - Const")
cross_section_2 = CrossSectionKaramba3D(
    FamilyNameOfCrossSection="DefaultCroSec",
    Material=matprops_3,
    LocalEccentricity_cm=division,
    Height_cm=number_slider_4,
    UpperFlangeWidth_cm=number_slider_6,
    LowerFlangeWidth_cm=number_slider_6,
    mode="Trapezoid")
cross_section_3 = CrossSectionKaramba3D(FamilyNameOfCrossSection="DefaultCroSec", Material=matprops_2, Height_cm=number_slider_7, mode="Shell - Const")
cross_section_4 = CrossSectionKaramba3D(
    FamilyNameOfCrossSection="DefaultCroSec",
    Material=matprops,
    Height_cm=number_slider_5,
    UpperFlangeWidth_cm=number_slider_5,
    LowerFlangeWidth_cm=number_slider_5,
    mode="Trapezoid")
srf = Surface([<surface referenced from the Rhino model> x11])
crv = Curve([<curve referenced from the Rhino model> x27])
crv_2 = Curve([<curve referenced from the Rhino model> x10])
debrep = DeconstructBrep(Brep=srf)  # -> flatten(Faces), flatten(Edges), Vertices
srf_2 = Surface(<surface referenced from the Rhino model>)
linetobeam = LineToBeamKaramba3D(Line=crv_2, Identifier="CLT_COL", CrossSection=cross_section_4, New=True, Remove=True, LimitDistance_m=0.005)  # -> Element, Points, Info
Z_2 = UnitZ(Factor=Slider(5, range=0..10))
end = EndPoints(Curve=crv_2)  # -> Start, End
mesh_breps = MeshBrepsKaramba3D(
    Brep=[debrep.Faces, srf_2],
    InclusionPoints=end.Start,
    MeshResolution=1,
    EdgeRefinementFactor=0.67,
    PointReduction=False,
    SmoothingStepSize=0,
    SmoothingIterations=5)  # -> Mesh, Info
demesh = DeconstructMesh(Mesh=mesh_breps.Mesh)  # -> flatten(Vertices), Faces, Colours, Normals
rdpoints = RemoveDuplicatePointsKaramba3D(Point=demesh.Vertices, LimitDistance=0.005)  # -> OutPoint, Info, Indexes
cluster = Cluster(L=mesh_breps.Mesh, line=crv)
pdecon = Deconstruct(Point=rdpoints.OutPoint)  # -> XComponent, YComponent, ZComponent
lng = ListLength(List=mesh_breps.Mesh)
subtraction = Subtraction(A=lng, B=1)
equals = Equality(FirstNumber=pdecon.ZComponent, SecondNumber="0")  # -> Equality, Inequality
partition = PartitionList(List=mesh_breps.Mesh, Size=subtraction)
cull = CullPattern(List=rdpoints.OutPoint, CullPattern=equals.Equality)
rev = Reverse(Vector=Z_2)
bang = ExplodeTree(Data=partition)  # -> Branch0, Branch1
loads = LoadsKaramba3D(Vector=Vector(0, 0, -1), mode="Gravity")
loads_2 = LoadsKaramba3D(Vector=rev, Mesh=bang.Branch1, mode="MeshLoad -Const.", menu=[buttons(off, on, off), buttons(on, on)])
supp = SupportKaramba3D(PosInd=flatten([cull, end.End]), menu=[buttons(on, on, on, off, off, off)])
meshtoshell = MeshToShellKaramba3D(Mesh=bang.Branch0, Identifier="CONCRETE", CrossSection=cross_section, LimitDistance_m=0.005)  # -> Element, Points, Info
meshtoshell_2 = MeshToShellKaramba3D(Mesh=bang.Branch1, CrossSection=cross_section_3, LimitDistance_m=0.005)  # -> Element, Points, Info
linetobeam_2 = LineToBeamKaramba3D(Line=cluster, Identifier="LVL", CrossSection=cross_section_2, New=True, Remove=True, LimitDistance_m=0.005)  # -> Element, Points, Info
assemble = AssembleModelKaramba3D(
    Elem=flatten([meshtoshell.Element, linetobeam.Element, linetobeam_2.Element, meshtoshell_2.Element]),
    Support=supp,
    Load=flatten([loads, loads_2]),
    LimitDistance_m=0.005)  # -> Model, Info, Mass_kg, CenterOfGravity
analyze = AnalyzeKaramba3D(Model=assemble.Model)  # -> CalculatedModel, MaximumDisplacement_cm, ResultingForceOfGravity_kN, ElasticEnergy_kNm
modelview = ModelViewKaramba3D(Model=analyze.CalculatedModel, ResultFactors=1, ResultCase=-1)  # -> Model, DeformedMesh, DeformedAxes, DeformedModel
beamview = BeamViewKaramba3D(Model=modelview.Model)  # -> Model, MeshesOfRenderedBeams, DeformedBeamAxes, LegendColors, LegendTags
shellview = ShellViewKaramba3D(Model=modelview.Model, IndexOfLayer=0)  # -> Model, MeshesOfRenderedShells, LegendColors, LegendTags
lca = InputForLCA(Model=modelview.Model)  # -> Materials, Mass, Volume, Geometry
panel = Panel(lca.Materials)
bang_2 = ExplodeTree(Data=lca.Volume)  # -> Branch0, Branch1, Branch2, Branch3
area = Area(Geometry=srf)  # -> Area, Centroid
lca_profile = SelectLCAProfile(menu=[dropdown(None), dropdown(None), dropdown(None), dropdown(None), dropdown(None), dropdown(None), checkbox(off)])
multiplication = Multiplication(A="25", B=area.Area)
lca_profile_2 = SelectLCAProfile(menu=[dropdown(None), dropdown(None), dropdown(None), dropdown(None), dropdown(None), dropdown(None), checkbox(off)])
lca_profile_3 = SelectLCAProfile(menu=[dropdown(None), dropdown(None), dropdown(None), dropdown(None), dropdown(None), dropdown(None), checkbox(off)])
lca_profile_4 = SelectLCAProfile(menu=[dropdown(None), dropdown(None), dropdown(None), dropdown(None), dropdown(None), dropdown(None), checkbox(off)])
lca_profile_5 = SelectLCAProfile(menu=[dropdown(None), dropdown(None), dropdown(None), dropdown(None), dropdown(None), dropdown(None), checkbox(off)])
material = DefineMaterial(LCAProfile=lca_profile_4, SetQuantity=bang_2.Branch1, mode="SI", menu=[dropdown(None)])
material_2 = DefineMaterial(LCAProfile=lca_profile_3, SetQuantity=multiplication, mode="SI", menu=[dropdown(None)])
material_3 = DefineMaterial(LCAProfile=lca_profile_5, SetQuantity=bang_2.Branch2, mode="SI", menu=[dropdown(None)])
material_4 = DefineMaterial(LCAProfile=lca_profile, SetQuantity=bang_2.Branch3, mode="SI", menu=[dropdown(None)])
material_5 = DefineMaterial(LCAProfile=lca_profile_2, SetQuantity=bang_2.Branch3, mode="SI", menu=[dropdown(None)])
entwine = Entwine(Branch00=material_3, Branch01=material_2, FlattenInputs=True)
construction = CreateConstruction(Material=material_4, menu=[dropdown(None)])
construction_2 = CreateConstruction(Material=material_5, menu=[dropdown(None)])
construction_3 = CreateConstruction(Material=material, menu=[dropdown(None)])
flip = FlipMatrix(Data=entwine)
construction_4 = CreateConstruction(Material=flip, GroupMaterials=Toggle(True), menu=[dropdown(None)])
lca_2 = RunLCA(
    Construction=[construction, construction_2, construction_3, construction_4],
    RunLCA=Toggle(True),
    Login=Button(),
    RunInCloud=Toggle(False))  # -> Construction, KgCO2e
disp_cm = Number(analyze.MaximumDisplacement_cm)
larger = LargerThan(FirstNumber=disp_cm, SecondNumber="1")  # -> LargerThan, OrEqualTo
multiplication_2 = Multiplication(A=larger.LargerThan, B="1000000")
addition = Addition(A=multiplication_2, B=lca_2.KgCO2e)
galapagos = Galapagos(fitness=num, gene=[number_slider_4, number_slider_7])
num = Number(addition)
co2e_kg = Number(lca_2.KgCO2e)
fitness = Panel(num)
kg_co2e = Panel(co2e_kg)

# ==== cluster Cluster
line = ClusterInput()
L = ClusterInput()
llinter = LineLineIntersectionKaramba3D(Line=line, LimitDistance_m=0.005)  # -> IntersectionPoints, flatten(LineSubSegements)
item = ListItem(List=L, Index="-1", Wrap=True)
demesh = DeconstructMesh(Mesh=item)  # -> Vertices, Faces, Colours, Normals
crv_cp = CurveClosestPoint(Point=flatten(demesh.Vertices), Curve=graft(llinter.LineSubSegements))  # -> Point, Parameter, Distance
smaller = SmallerThan(FirstNumber=crv_cp.Distance, SecondNumber=Slider(0.01, range=0..0.01))  # -> SmallerThan, OrEqualTo
cull = CullPattern(List=crv_cp.Parameter, CullPattern=smaller.SmallerThan)
shatter = Shatter(Curve=graft(llinter.LineSubSegements), Parameters=cull)  # -> flatten(Segments)
S = ClusterOutput(shatter)
