# Grasshopper definition Load Combinations - Warren Truss.gh (Grasshopper 1.0.7)
# plug-ins: karambaGH, KarambaPack

# ---- group: Truss Geometry
X = UnitX(Factor=Slider(30, range=10..50))
Z = UnitZ(Factor=Slider(3, range=0..10))
pt = Point(Point(0, 0, 0))
rev = Reverse(Vector=Z)
move = Move(Geometry=pt, Motion=X)  # -> Geometry, Transform
ln = Line(StartPoint=pt, EndPoint=move.Geometry)
divide = DivideCurve(Curve=ln, Count=Slider(14, range=2..20), Kinks=False)  # -> Points, Tangents, Parameters
lng = ListLength(List=divide.Points)
move_2 = Move(Geometry=divide.Points, Motion=rev)  # -> Geometry, Transform
panel = Panel("""0
-1""")
dup = DuplicateData(Data=["0", "1"], Number=lng, Order=True)
cull_i = CullIndex(List=move_2.Geometry, Indices=panel, Wrap=True)
split = SplitList(List=dup, Index=lng)  # -> ListA, ListB
p_n_c = PickNChoose(Pattern=split.ListA, Stream0=divide.Points, Stream1=move_2.Geometry)
culln = CullNth(List=cull_i, CullFrequency=2)
culln_2 = CullNth(List=divide.Points, CullFrequency=2)
item = ListItem(List=culln_2, Index=expr("x/4", lng), Wrap=True)
entwine = Entwine(Branch00=culln_2, Branch01=culln, Branch02=p_n_c, FlattenInputs=True)
cull_i_2 = CullIndex(List=entwine, Indices="-1", Wrap=True)
shift = ShiftList(List=entwine, Shift=1, Wrap=False)
ln_2 = Line(StartPoint=cull_i_2, EndPoint=shift)  # -> simplify(Line)
bang = ExplodeTree(Data=ln_2)  # -> Branch0, Branch1, Branch2
upperchord_crv = Curve(bang.Branch0)
lowerchord_crv = Curve(bang.Branch1)
diagonals_crv = Curve(bang.Branch2)
supports_pt = Point([pt, move.Geometry])

# ---- group: Karamba - Model Definition
matselect = MaterialSelectionKaramba(menu=[dropdown(1), dropdown(2)])
crosecrselect = CrossSectionRangeSelectorKaramba(MaximumHeight_cm=-1, MaximumWidth_cm=-1, Material=matselect, menu=[dropdown(1), dropdown(1), dropdown(3)])
item_2 = ListItem(List=supports_pt, Index=0, Wrap=True)  # -> Item, Item1
crane_pt = Point(item)
Z_2 = UnitZ(Factor=Slider(-50, range=-50..0))
Z_3 = UnitZ(Factor=Slider(-12, range=-15..0))
Z_4 = UnitZ(Factor=Slider(-15, range=-15..0))
gravity_vec = Vector(Vector(0, 0, -1))
Z_5 = UnitZ(Factor=Slider(-6, range=-6..0))
beam_joints = BeamJointsKaramba(
    ElementIdentifiers="D",
    CtKNMAtStartingNode=Vector(0, 0, 0),
    CrKNmRadAtStartingNode=Vector(0, 0, 0),
    CtKNMAtEndNode=Vector(0, 0, 0),
    CrKNmRadAtEndNode=Vector(0, 0, 0),
    menu=[buttons(off, off, off, off, on, off), buttons(off, off, off, off, on, off)])
crosecselect = CrossSectionSelectorKaramba(CrossSections=crosecrselect, NameOrListIndexOfCrossSection="HEA300", ElementsIdentifiers=["UC", "LC", "D"])  # -> CrossSection, Info
supp = SupportKaramba(PosInd=item_2.Item1, menu=[buttons(off, on, on, off, off, off)])
linetobeam = LineToBeamKaramba(Line=upperchord_crv, Identifier="UC", New=True, Remove=True, LimitDistance_m=0.005)  # -> Element, Points, Info
linetobeam_2 = LineToBeamKaramba(Line=lowerchord_crv, Identifier="LC", New=True, Remove=True, LimitDistance_m=0.005)  # -> Element, Points, Info
linetobeam_3 = LineToBeamKaramba(Line=diagonals_crv, Identifier="D", New=True, Remove=True, LimitDistance_m=0.005)  # -> Element, Points, Info
supp_2 = SupportKaramba(PosInd=item_2.Item, menu=[buttons(on, on, on, on, off, off)])
loads = LoadsKaramba(ForceVector=Z_2, Local=False, PosInd=crane_pt, LCase="5", mode="Point")
loads_2 = LoadsKaramba(Vector=Z_3, BeamIdentifiers="UC", LCase="4", mode="Uniform Line", menu=[buttons(on, off, off)])
loads_3 = LoadsKaramba(ChangeOfTemperature=Slider(-30, range=-30..30), ElementIdentifiers=["UC", "LC", "D"], LCase="6", mode="Temperature")
loads_4 = LoadsKaramba(Vector=Z_4, BeamIdentifiers="UC", LCase="3", mode="Uniform Line", menu=[buttons(on, off, off)])
loads_5 = LoadsKaramba(Vector=Z_5, BeamIdentifiers="UC", LCase="2", mode="Uniform Line", menu=[buttons(on, off, off)])
loads_6 = LoadsKaramba(Vector=gravity_vec, LCase="1", mode="Gravity")
assemble = AssembleModelKaramba(
    Elem=flatten([linetobeam.Element, linetobeam_2.Element, linetobeam_3.Element]),
    Support=[supp_2, supp],
    Load=flatten([loads_6, loads_5, loads_4, loads_2, loads, loads_3]),
    CrossSection=crosecselect.CrossSection,
    Joint=beam_joints,
    LimitDistance_m=0.005)  # -> Model, Info, Mass_kg, CenterOfGravity

# ----
analyze = AnalyzeKaramba3D(Model=assemble.Model)  # -> CalculatedModel, MaximumDisplacement_cm, ResultingForceOfGravity_kN, ElasticEnergy_kNm

# ---- group: Load Combinations in Karamba - Approach 1
# The definition of the load combinations can be easily imported from RFEM or RSTAB.
# Following Load Types are supported: Point Lodas, Uniformly Distributed Loads, Mesh Loads, Gravity Loads and Temperature Loads.
# In the output model, the load cases are replaced by the load combinations.
load_combinations = Panel("""1.35*LC1
1.35*LC1 + 1.35*LC2
1.35*LC1 + 1.5*LC3
1.35*LC1 + 1.35*LC2 + 1.5*LC3
1.35*LC1 + 1.35*LC2 + 1.5*LC3 + 0.9*LC4
1.35*LC1 + 1.35*LC2 + 1.5*LC3 + 0.9*LC4 + 1.2*LC5
1.35*LC1 + 1.35*LC2 + 1.5*LC3 + 0.9*LC4 + 1.2*LC5 + 0.9*LC6
1.35*LC1 + 1.35*LC2 + 1.5*LC3 + 0.9*LC4 + 0.9*LC6
1.35*LC1 + 1.35*LC2 + 1.5*LC3 + 1.2*LC5
1.35*LC1 + 1.35*LC2 + 1.5*LC3 + 1.2*LC5 + 0.9*LC6
1.35*LC1 + 1.35*LC2 + 1.5*LC3 + 0.9*LC6
1.35*LC1 + 1.5*LC3 + 0.9*LC4
1.35*LC1 + 1.5*LC3 + 0.9*LC4 + 1.2*LC5
1.35*LC1 + 1.5*LC3 + 0.9*LC4 + 1.2*LC5 + 0.9*LC6
1.35*LC1 + 1.5*LC3 + 0.9*LC4 + 0.9*LC6
1.35*LC1 + 1.5*LC3 + 1.2*LC5
1.35*LC1 + 1.5*LC3 + 1.2*LC5 + 0.9*LC6
1.35*LC1 + 1.5*LC3 + 0.9*LC6
1.35*LC1 + 1.5*LC4
1.35*LC1 + 1.35*LC2 + 1.5*LC4
1.35*LC1 + 1.35*LC2 + 0.75*LC3 + 1.5*LC4
1.35*LC1 + 1.35*LC2 + 0.75*LC3 + 1.5*LC4 + 1.2*LC5
1.35*LC1 + 1.35*LC2 + 0.75*LC3 + 1.5*LC4 + 1.2*LC5 + 0.9*LC6
1.35*LC1 + 1.35*LC2 + 0.75*LC3 + 1.5*LC4 + 0.9*LC6
1.35*LC1 + 1.35*LC2 + 1.5*LC4 + 1.2*LC5
1.35*LC1 + 1.35*LC2 + 1.5*LC4 + 1.2*LC5 + 0.9*LC6
1.35*LC1 + 1.35*LC2 + 1.5*LC4 + 0.9*LC6
1.35*LC1 + 0.75*LC3 + 1.5*LC4
1.35*LC1 + 0.75*LC3 + 1.5*LC4 + 1.2*LC5
1.35*LC1 + 0.75*LC3 + 1.5*LC4 + 1.2*LC5 + 0.9*LC6
1.35*LC1 + 0.75*LC3 + 1.5*LC4 + 0.9*LC6
1.35*LC1 + 1.5*LC4 + 1.2*LC5
1.35*LC1 + 1.5*LC4 + 1.2*LC5 + 0.9*LC6
1.35*LC1 + 1.5*LC4 + 0.9*LC6
1.35*LC1 + 1.5*LC5
1.35*LC1 + 1.35*LC2 + 1.5*LC5
1.35*LC1 + 1.35*LC2 + 0.75*LC3 + 1.5*LC5
1.35*LC1 + 1.35*LC2 + 0.75*LC3 + 0.9*LC4 + 1.5*LC5
1.35*LC1 + 1.35*LC2 + 0.75*LC3 + 0.9*LC4 + 1.5*LC5 + 0.9*LC6
1.35*LC1 + 1.35*LC2 + 0.75*LC3 + 1.5*LC5 + 0.9*LC6
1.35*LC1 + 1.35*LC2 + 0.9*LC4 + 1.5*LC5
1.35*LC1 + 1.35*LC2 + 0.9*LC4 + 1.5*LC5 + 0.9*LC6
1.35*LC1 + 1.35*LC2 + 1.5*LC5 + 0.9*LC6
1.35*LC1 + 0.75*LC3 + 1.5*LC5
1.35*LC1 + 0.75*LC3 + 0.9*LC4 + 1.5*LC5
1.35*LC1 + 0.75*LC3 + 0.9*LC4 + 1.5*LC5 + 0.9*LC6
1.35*LC1 + 0.75*LC3 + 1.5*LC5 + 0.9*LC6
1.35*LC1 + 0.9*LC4 + 1.5*LC5
1.35*LC1 + 0.9*LC4 + 1.5*LC5 + 0.9*LC6
1.35*LC1 + 1.5*LC5 + 0.9*LC6
1.35*LC1 + 1.5*LC6
1.35*LC1 + 1.35*LC2 + 1.5*LC6
1.35*LC1 + 1.35*LC2 + 0.75*LC3 + 1.5*LC6
1.35*LC1 + 1.35*LC2 + 0.75*LC3 + 0.9*LC4 + 1.5*LC6
1.35*LC1 + 1.35*LC2 + 0.75*LC3 + 0.9*LC4 + 1.2*LC5 + 1.5*LC6
1.35*LC1 + 1.35*LC2 + 0.75*LC3 + 1.2*LC5 + 1.5*LC6
1.35*LC1 + 1.35*LC2 + 0.9*LC4 + 1.5*LC6
1.35*LC1 + 1.35*LC2 + 0.9*LC4 + 1.2*LC5 + 1.5*LC6
1.35*LC1 + 1.35*LC2 + 1.2*LC5 + 1.5*LC6
1.35*LC1 + 0.75*LC3 + 1.5*LC6
1.35*LC1 + 0.75*LC3 + 0.9*LC4 + 1.5*LC6
1.35*LC1 + 0.75*LC3 + 0.9*LC4 + 1.2*LC5 + 1.5*LC6
1.35*LC1 + 0.75*LC3 + 1.2*LC5 + 1.5*LC6
1.35*LC1 + 0.9*LC4 + 1.5*LC6
1.35*LC1 + 0.9*LC4 + 1.2*LC5 + 1.5*LC6
1.35*LC1 + 1.2*LC5 + 1.5*LC6
LC1
LC1 + LC2
LC1 + LC3
LC1 + LC2 + LC3
LC1 + LC2 + LC3 + 0.6*LC4
LC1 + LC2 + LC3 + 0.6*LC4 + 0.8*LC5
LC1 + LC2 + LC3 + 0.6*LC4 + 0.8*LC5 + 0.6*LC6
LC1 + LC2 + LC3 + 0.6*LC4 + 0.6*LC6
LC1 + LC2 + LC3 + 0.8*LC5
LC1 + LC2 + LC3 + 0.8*LC5 + 0.6*LC6
LC1 + LC2 + LC3 + 0.6*LC6
LC1 + LC3 + 0.6*LC4
LC1 + LC3 + 0.6*LC4 + 0.8*LC5
LC1 + LC3 + 0.6*LC4 + 0.8*LC5 + 0.6*LC6
LC1 + LC3 + 0.6*LC4 + 0.6*LC6
LC1 + LC3 + 0.8*LC5
LC1 + LC3 + 0.8*LC5 + 0.6*LC6
LC1 + LC3 + 0.6*LC6
LC1 + LC4
LC1 + LC2 + LC4
LC1 + LC2 + 0.5*LC3 + LC4
LC1 + LC2 + 0.5*LC3 + LC4 + 0.8*LC5
LC1 + LC2 + 0.5*LC3 + LC4 + 0.8*LC5 + 0.6*LC6
LC1 + LC2 + 0.5*LC3 + LC4 + 0.6*LC6
LC1 + LC2 + LC4 + 0.8*LC5
LC1 + LC2 + LC4 + 0.8*LC5 + 0.6*LC6
LC1 + LC2 + LC4 + 0.6*LC6
LC1 + 0.5*LC3 + LC4
LC1 + 0.5*LC3 + LC4 + 0.8*LC5
LC1 + 0.5*LC3 + LC4 + 0.8*LC5 + 0.6*LC6
LC1 + 0.5*LC3 + LC4 + 0.6*LC6
LC1 + LC4 + 0.8*LC5
LC1 + LC4 + 0.8*LC5 + 0.6*LC6
LC1 + LC4 + 0.6*LC6
LC1 + LC5
LC1 + LC2 + LC5
LC1 + LC2 + 0.5*LC3 + LC5
LC1 + LC2 + 0.5*LC3 + 0.6*LC4 + LC5
LC1 + LC2 + 0.5*LC3 + 0.6*LC4 + LC5 + 0.6*LC6
LC1 + LC2 + 0.5*LC3 + LC5 + 0.6*LC6
LC1 + LC2 + 0.6*LC4 + LC5
LC1 + LC2 + 0.6*LC4 + LC5 + 0.6*LC6
LC1 + LC2 + LC5 + 0.6*LC6
LC1 + 0.5*LC3 + LC5
LC1 + 0.5*LC3 + 0.6*LC4 + LC5
LC1 + 0.5*LC3 + 0.6*LC4 + LC5 + 0.6*LC6
LC1 + 0.5*LC3 + LC5 + 0.6*LC6
LC1 + 0.6*LC4 + LC5
LC1 + 0.6*LC4 + LC5 + 0.6*LC6
LC1 + LC5 + 0.6*LC6
LC1 + LC6
LC1 + LC2 + LC6
LC1 + LC2 + 0.5*LC3 + LC6
LC1 + LC2 + 0.5*LC3 + 0.6*LC4 + LC6
LC1 + LC2 + 0.5*LC3 + 0.6*LC4 + 0.8*LC5 + LC6
LC1 + LC2 + 0.5*LC3 + 0.8*LC5 + LC6
LC1 + LC2 + 0.6*LC4 + LC6
LC1 + LC2 + 0.6*LC4 + 0.8*LC5 + LC6
LC1 + LC2 + 0.8*LC5 + LC6
LC1 + 0.5*LC3 + LC6
LC1 + 0.5*LC3 + 0.6*LC4 + LC6
LC1 + 0.5*LC3 + 0.6*LC4 + 0.8*LC5 + LC6
LC1 + 0.5*LC3 + 0.8*LC5 + LC6
LC1 + 0.6*LC4 + LC6
LC1 + 0.6*LC4 + 0.8*LC5 + LC6
LC1 + 0.8*LC5 + LC6
LC1
LC1 + LC2
LC1 + 0.2*LC3
LC1 + LC2 + 0.2*LC3
LC1 + LC2 + 0.2*LC3 + 0.5*LC5
LC1 + 0.2*LC3 + 0.5*LC5
LC1 + 0.2*LC4
LC1 + LC2 + 0.2*LC4
LC1 + LC2 + 0.2*LC4 + 0.5*LC5
LC1 + 0.2*LC4 + 0.5*LC5
LC1 + 0.7*LC5
LC1 + LC2 + 0.7*LC5
LC1 + 0.5*LC6
LC1 + LC2 + 0.5*LC6
LC1 + LC2 + 0.5*LC5 + 0.5*LC6
LC1 + 0.5*LC5 + 0.5*LC6
LC1
LC1 + LC2
LC1 + LC2 + 0.5*LC5
LC1 + 0.5*LC5""")
lcombos = LoadCombinations(InModel=assemble.Model, LoadCombinations=load_combinations, Index=0)  # -> OutModel, OutLoads
analyze_2 = AnalyzeKaramba3D(Model=lcombos.OutModel)  # -> CalculatedModel, MaximumDisplacement_cm, ResultingForceOfGravity_kN, ElasticEnergy_kNm

# ----
license = LicenseKaramba3D()
panel_2 = Panel(license)
panel_3 = Panel(analyze_2.MaximumDisplacement_cm)
