# Grasshopper definition Mass Source - Irregular Bracing.gh (Grasshopper 1.0.7)
# plug-ins: KarambaPack, karambaGH

# ---- group: Building Geometry
number_slider = Slider(8, range=0..10)
number_slider_2 = Slider(0, range=0..1)
range = Range(Domain=Slider(30, range=0..100), Steps=Slider(10, range=0..15))
crossref = CrossReference(ListA=[number_slider_2, number_slider], ListB=[number_slider, number_slider_2], CrossMode=1)  # -> ListA, ListB
pt = ConstructPoint(XCoordinate=crossref.ListA, YCoordinate=crossref.ListB, ZCoordinate=0)
Z = UnitZ(Factor=range)
move = Move(Geometry=graft(pt), Motion=Z)  # -> simplify(Geometry), Transform
flip = FlipMatrix(Data=move.Geometry)
split = SplitTree(Data=flip, Masks=flatten("{0}"))  # -> Positive, Negative
relitem = RelativeItem(Tree=move.Geometry, Offset="{0}[1]", WrapPaths=False, WrapItems=False)  # -> ItemA, ItemB
split_2 = SplitTree(Data=move.Geometry, Masks=flatten("{0,1}"))  # -> Positive, Negative
item = ListItem(List=split.Negative, Index=0, Wrap=True)  # -> Item, Item1, Item2, Item3
ln = Line(StartPoint=relitem.ItemA, EndPoint=relitem.ItemB)
relitem_2 = RelativeItem(Tree=split_2.Positive, Offset="{1}[1]", WrapPaths=Toggle(True), WrapItems=False)  # -> ItemA, ItemB
srf4pt = _4PointSurface(CornerA=item.Item, CornerB=item.Item1, CornerC=item.Item3, CornerD=item.Item2)
mesh_breps = MeshBreps(
    Brep=flatten(srf4pt),
    MeshResolution=Slider(0.5, range=0.1..1),
    EdgeRefinementFactor=0.67,
    PointReduction=False,
    SmoothingStepSize=0,
    SmoothingIterations=5)  # -> Mesh, Info
ln_2 = Line(StartPoint=relitem_2.ItemA, EndPoint=relitem_2.ItemB)
diagonals_crv = Curve(flatten(ln_2))
columns_crv = Curve(flatten(ln))
slabs_mesh = Mesh(mesh_breps.Mesh)
supports_pt = Point(split.Positive)

# ---- group: Karamba - Model Definition
matselect = MaterialSelectionKaramba(menu=[dropdown(1), dropdown(2)])
supp = SupportKaramba(PosInd=supports_pt, menu=[buttons(on, on, on, off, off, off)])
matselect_2 = MaterialSelectionKaramba(menu=[dropdown(3), dropdown(8)])
meshtoshell = MeshToShellKaramba(Mesh=slabs_mesh, Identifier="Slabs", LimitDistance_m=0.005)  # -> Element, Points, Info
cross_sections = CrossSectionsKaramba(
    FamilyNameOfCrossSection="DefaultCroSec",
    ElementsIdentifiers="Bra",
    Material=matselect,
    Diameter_cm="20",
    WallThickness_cm="1",
    mode="Circular Hollow")
linetobeam = LineToBeamKaramba(Line=diagonals_crv, Identifier="Bra", New=True, Remove=True, LimitDistance_m=0.005)  # -> Element, Points, Info
linetobeam_2 = LineToBeamKaramba(Line=columns_crv, Identifier="Col", New=True, Remove=True, LimitDistance_m=0.005)  # -> Element, Points, Info
Z_2 = UnitZ(Factor=Slider(-5, range=-5..0))
cross_sections_2 = CrossSectionsKaramba(
    FamilyNameOfCrossSection="DefaultCroSec",
    ElementsIdentifiers="Col",
    Material=matselect_2,
    Height_cm="35",
    UpperFlangeWidth_cm="35",
    LowerFlangeWidth_cm="35",
    mode="Trapezoid")
cross_sections_3 = CrossSectionsKaramba(
    FamilyNameOfCrossSection="DefaultCroSec",
    ElementsIdentifiers="Slabs",
    Material=matselect_2,
    Height_cm="30",
    mode="Shell - Const")
loads = LoadsKaramba(Vector=Z_2, Mesh=slabs_mesh, LCase="1", mode="MeshLoad -Const.", menu=[buttons(off, on, off), buttons(on, off)])
loads_2 = LoadsKaramba(Vector=Vector(0, 0, -1), LCase=0, mode="Gravity")
assemble = AssembleModelKaramba(
    Elem=flatten([linetobeam_2.Element, linetobeam.Element, meshtoshell.Element]),
    Support=supp,
    Load=flatten([loads_2, loads]),
    CrossSection=flatten([cross_sections, cross_sections_2, cross_sections_3]),
    LimitDistance_m=0.005)  # -> Model, Info, Mass_kg, CenterOfGravity

# ---- group: Kramba - Mass Source
# The Mass Source must be specified through a Load Combination. Only Point Loads are supported.
panel = Panel("LC0+LC1")
mssrc = MassSource(InModel=assemble.Model, LoadCombinations=panel)

# ---- group: Karamba - Natural Vibrations
nvibes = NaturalVibrationsKaramba(Model=mssrc, FromIndex=1, NumberOfModes="8", MaximumNumberOfIterations=30, Epsilon=1e-05)  # -> ModelWithVibrationModesAsLoadCaseResults, NaturalFrequencies_Hz, ModalMass_kg, ParticipationFactorInGlobalXYAndZDirection
panel_2 = Panel(nvibes.NaturalFrequencies_Hz)
